# Grasshopper definition grasshopper-basic-example.ghx (Grasshopper 0.9.76)
# plug-ins: Python Interpreter

reset = Button()
python = PythonScript(port=reset)
# ---------- python: Python ----------
import scriptcontext as sc
from compas_fab.fab.grasshopper import unload_modules
print unload_modules('compas_fab')

if "rfl_meshes" in sc.sticky:
    del sc.sticky["rfl_meshes"]
# ---------- end python ----------

building_member = Mesh(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)
gripping_plane = Plane(Plane(origin=(7852.514188, 9288.12028, 1500), x=(1, 0, 0), y=(0, -1, 0)))
list = ValueList({"Robot 11": 11, "Robot 12": 12, "Robot 21": 21, "Robot 22": 22}, selected="Robot 12")
goal_plane = Plane(Plane(origin=(12037.16057, 7811.497132, 2000), x=(0, -1, 0), y=(-0.02117759615, 0, -0.9997757296)))

# ----
# Basic config
trigger = BooleanToggle(True)
path_planning = PythonScript(
    trigger=trigger,
    selected_robot=list,
    gripping_plane_or_config=gripping_plane,
    goal_plane_or_pose=goal_plane,
    building_member=building_member)  # -> out, path, a
# ---------- path_planning: Python ----------
import logging
from compas_fab.fab.robots import Pose
from compas_fab.fab.robots.rfl import *
from compas_fab.fab.grasshopper import *
from compas_fab.fab.grasshopper.path_planning import InputParameterParser, PathPlanner

logging.basicConfig(level=logging.DEBUG)
LOG = logging.getLogger()
print gripping_plane_or_config
if trigger:
    options = {
            'robots': [
                {
                    'robot': selected_robot,
                    'start': gripping_plane_or_config,
                    'goal': goal_plane_or_pose,
                    'building_member': building_member
                }
            ]
        }

    path = PathPlanner.find_path(**options)
# ---------- end path_planning ----------
visualization = PythonScript(frame=Slider(100, range=0..100), selected_robot=list, building_member=building_member, path=path_planning.path)  # -> out, a; inputs frame: Int32, path: list
# ---------- visualization: Python ----------
import logging
import scriptcontext as sc

from compas_fab.fab.robots import Simulator
from compas_fab.fab.robots.rfl import Robot
from compas_fab.fab.grasshopper.path_planning import PathVisualizer, InputParameterParser

LOG = logging.getLogger()
path = InputParameterParser().compact_list(path)

#if "rfl_meshes" in sc.sticky:
#    del sc.sticky["rfl_meshes"]

if path:
    with Simulator(debug=True) as simulator:
        frame_index = ((len(path) - 1) * frame) // 100
        LOG.debug('Rendering frame %d out of %d', frame_index + 1, len(path))
        
        robot = Robot(selected_robot, client=simulator)
        visualizer = PathVisualizer(simulator, robot, building_member)
        a = visualizer.get_frame_meshes(path, frame_index, sc.sticky)
# ---------- end visualization ----------
