# Grasshopper definition grasshopper-path-planner.ghx (Grasshopper 0.9.76)
# plug-ins: Python Interpreter

building_member_mesh = Mesh(<mesh referenced from the Rhino model>)
collision_meshes = Mesh(<mesh referenced from the Rhino model>)
gripping_plane = Plane(PlaneXY(7.852514188, -9.28812028, -1.5))
list = ValueList({"Robot 11": 11, "Robot 12": 12, "Robot 21": 21, "Robot 22": 22}, selected="Robot 12")
goal_plane = Plane(Plane(origin=(9.637160567, -7.811497132, -2.5), x=(0, -1, 0), y=(-0.02117759615, 0, -0.9997757296)))

# ----
# Algorithm
# Resolution (relative to space's extent)
# Metric (1=blocked joint)
number_slider = Slider(0.02, range=0..0.5)
list_2 = ValueList({"bitrrt", "bkpiece1", "est", "kpiece1", "lazyprmstar", "lbkpiece1", "lbtrrt", "pdst", "prm", "prrt", "rrt", "rrtconnect", "rrtstar", "sbl", "stride", "trrt"}, selected="rrtconnect")

# ----
# Basic config
trigger = BooleanToggle(False)
path_planning = PythonScript(
    trigger=trigger,
    selected_robot=list,
    gripping_plane_or_config=gripping_plane,
    goal_plane_or_pose=goal_plane,
    building_member=building_member_mesh,
    collision_meshes=collision_meshes,
    algorithm=list_2,
    resolution=number_slider,
    metric="1,0.1,0.1,0.1,0.1,0.1,0.1,0.1,0.1")  # -> out, path, a; inputs collision_meshes: list
# ---------- path_planning: Python ----------
import logging
from compas_fabrication.fabrication.robots.rfl import *
from compas_fabrication.fabrication.grasshopper import *
from compas_fabrication.fabrication.grasshopper.path_planning import InputParameterParser

logging.basicConfig(level=logging.DEBUG)
LOG = logging.getLogger()

# Clean up input parameters
parser = InputParameterParser()
start = parser.get_config_or_pose(gripping_plane_or_config)
goal = parser.get_pose(goal_plane_or_pose)
collision_meshes = parser.compact_list(collision_meshes)


if trigger:
    with Simulator(debug=True) as simulator:
        robot = Robot(selected_robot, simulator)

        if start:
            simulator.set_robot_config(robot, start)
        if building_member:
            simulator.add_building_member(robot, mesh_from_guid(building_member))

        if goal:
            path = simulator.find_path_plan(robot, goal,
                                            metric_values=map(float, metric.split(',')) if metric else [0.1] * 9,
                                            collision_meshes=map(mesh_from_guid, collision_meshes),
                                            algorithm=algorithm or 'rrtconnect',
                                            resolution=resolution or 0.02,
                                            shallow_state_search=True)

            LOG.info('Found path of %d steps', len(path))
        else:
            start = start or simulator.get_robot_config(robot)
            path = [start]
# ---------- end path_planning ----------

# ----
# Additional configuration
# Debug info
# All components in this group are optional and can be deleted
panel = Panel(path_planning.out)

visualization = PythonScript(frame=Slider(0, range=0..100), selected_robot=list, building_member=building_member_mesh, path=path_planning.path)  # -> out, a; inputs frame: Int32, path: list
# ---------- visualization: Python ----------
import logging
import scriptcontext as sc

from compas_fabrication.fabrication.robots.rfl import Simulator, Robot
from compas_fabrication.fabrication.grasshopper.path_planning import PathVisualizer, InputParameterParser

LOG = logging.getLogger()
path = InputParameterParser().compact_list(path)

if path:
    with Simulator(debug=True) as simulator:
        frame_index = ((len(path) - 1) * frame) // 100
        LOG.debug('Rendering frame %d out of %d', frame_index + 1, len(path))
        
        robot = Robot(selected_robot, client=simulator)
        visualizer = PathVisualizer(simulator, robot, building_member)
        a = visualizer.get_frame_meshes(path, frame_index, sc.sticky)
# ---------- end visualization ----------
