# Grasshopper definition robot.ghx (Grasshopper 0.9.76)
# plug-ins: Python Interpreter

python = PythonScript()  # -> out, M
# ---------- python: Python ----------
from compas.robots import Robot
from compas.datastructures.mesh import Mesh
from compas_fab import get_data
import os

from compas_ghpython import unload_modules

unload_modules("compas")

from compas_ghpython import mesh_draw
from compas.geometry.xforms import Transformation
from compas.geometry import Frame

from compas_ghpython.geometry import xtransform


class IndustrialRobot(Robot):
    """Represents an the base class for all robots.

    Communication with the actual robot is delegated via the `client` instance
    passed when initializing the robot.

    Args:
        client (:obj:`object`): A client to execute the commands such as 
            :class:`ros_client`.

    
    https://github.com/ros-visualization/rviz/blob/melodic-devel/src/rviz/robot/robot.cpp

    http://wiki.ros.org/urdf/Tutorials/Parse%20a%20urdf%20file
    """

    mesh_draw_func = None
    mesh_transform_func = None

    def __init__(self, client = None):
        self.client = client
        if client:
            # get urdf from robot description parameter server
            def func(text):
                self = super(IndustrialRobot, self).from_urdf_string(text)
            param = roslibpy.Param(self.ros_client, '/robot_description')
            param.get(func)
        else:
            self = super(IndustrialRobot, self).__init__(None)
    
    @classmethod
    def from_urdf_file(cls, file, client = None):
        urdf_robot = super(IndustrialRobot, cls).from_urdf_file(file)
        robot = cls(client)
        robot.name = urdf_robot.name
        robot.links = urdf_robot.links
        robot.joints = urdf_robot.joints
        return robot
    
    def get_root_link(self):
        """Returns the robot's root link.
        """
        root_link = None

        for link in self.links:
            found = False
            # search the link, which is never child for a joint
            for joint in self.joints:
                if str(joint.child) == link.name:
                    found = True
            if not found:
                root_link = link
                break
        if not root_link:
            raise Exception("Root link not found. Something wrong with URDF?")
        return root_link

   
    def get_child_joint(self, link):
        for joint in self.joints:
            if str(joint.parent) == link.name:
                return joint
    
    def get_child_link(self, joint):
        for link in self.links:
            if link.name == joint.child.link:
                return link
    
    def joint_set_transforms(self, visual, v_position, v_orientation):
        # parent_link_position, parent_link_orientation
        position = parent_link_position + parent_link_orientation * joint_origin_pos_
        orientation = parent_link_orientation * joint_origin_rot_
        
        #position_property_->setVector( position );
        #orientation_property_->setQuaternion( orientation );
        #if ( axis_ )
        #    axis_->setPosition( position );
        #    axis_->setOrientation( orientation );
        #    axis_->setDirection( parent_link_orientation * axis_property_->getVector() );
    
    def link_set_transforms(self, visual, v_position, v_orientation, collision, c_position, c_orientation):
        pass

        
    def load(self, mesh_draw_func = None, mesh_transform_func = None):
        
        self.mesh_draw_func = mesh_draw_func
        self.mesh_transform_func = mesh_transform_func

        # 1. search root link
        root_link = self.get_root_link()
        next_link = root_link

        meshes = []
        count = 0
        while next_link:
            next_joint = self.get_child_joint(next_link)
            if not next_joint:
                break
            next_link = self.get_child_link(next_joint)

            print(next_joint.name)
            print(next_link.name)

            print(next_joint.origin)
            if next_joint.axis:
                axis = [next_joint.axis.x, next_joint.axis.y, next_joint.axis.z]
            print(next_link.visual)
            print("=")
            link = next_link
            if len(link.visual):
                package_filename = link.visual[0].geometry.shape.filename
                filename = package_filename[len("package://"):]
                filename = get_data(filename)
                if not os.path.isfile(filename):
                    raise FileNotFoundError("No such file: '%s'" % filename)
                extension = filename[(filename.rfind(".") + 1):]
                if extension == "dae": # no dae support yet
                    #mesh = Mesh.from_dae(filename)
                    obj_filename = filename.replace(".dae", ".obj")
                    if os.path.isfile(obj_filename):
                        mesh = Mesh.from_obj(obj_filename)
                    else:
                        raise FileNotFoundError("No such file: '%s'" % filename)
                elif extension == "obj":
                    mesh = Mesh.from_obj(filename)
                elif extension == "stl":
                    mesh = Mesh.from_stl(filename)
                else:
                    raise ValueError("%s file types not yet supported" % 
                        extension.upper())
                #print(link.visual[0].geometry.shape.scale)
                
                if self.mesh_draw_func:
                    mesh = self.mesh_draw_func(mesh)
                    meshes.append(mesh)
                count +=1
                    
                #print(link.visual[0].geometry.shape.scale)
            if count == 7:
                break
        return meshes
    
    @property
    def dof(self):
        return len(self.links)
        
        
 
 
ur5 = IndustrialRobot.from_urdf_file(r"C:\Users\rustr\Desktop\tmp\ur5.urdf.xml")
M = ur5.load(mesh_draw, xtransform)
# ---------- end python ----------
python_2 = PythonScript()  # -> out, ur5
# ---------- python_2: Python ----------
from compas_ghpython import mesh_draw
from compas_ghpython.geometry import xtransform
from compas_fab.fab.robots.ur import IndustrialRobot


urdf_file = r"C:\Users\rustr\Desktop\tmp\ur5.urdf.xml"

ur5 = IndustrialRobot.from_urdf_file(urdf_file, None, mesh_draw, xtransform)
ur5.load()
# ---------- end python_2 ----------
python_3 = PythonScript(x=Button())  # -> out, a
# ---------- python_3: Python ----------
from compas_rhino.utilities.misc import get_tolerance
from compas_rhino.utilities.misc import unload_modules
#utilities.misc import unload_modules

from compas_ghpython import unload_modules
unload_modules("compas")
# ---------- end python_3 ----------
python_4 = PythonScript(robot=python_2.ur5)  # -> out, M
# ---------- python_4: Python ----------
M = []


for link in robot.urdf_iter_links():
    if len(link.visual_geometry):
        for mesh in link.visual_geometry:
            M.append(mesh)


for j in robot.urdf_iter_joints():
    print j.origin
    if j.type == "revolute":
        print j
        print j


import Rhino.Geometry as rg
# ---------- end python_4 ----------
item = ListItem(List=python.M, Index=2, Wrap=True)
rotax = RotateAxis(Geometry=item, Angle=1.570796327, Axis=Line((0, 0, 0), (0, 556.4722999, 0)))  # -> Geometry, Transform
rad = Radians(Degrees=Slider(-90, range=-180..180))
rotax_2 = RotateAxis(Geometry=rotax.Geometry, Angle=rad, Axis=Line((0, 0, 0), (0, 0, 594.4344816)))  # -> Geometry, Transform
vec = VectorXYZ(XComponent=Slider(0, range=0..1000), YComponent=Slider(133, range=0..1000), ZComponent=Slider(89, range=0..1000))  # -> Vector, Length
move = Move(Geometry=rotax_2.Geometry, Motion=vec.Vector)  # -> Geometry, Transform
python_5 = PythonScript(X1=rotax.Transform, X2=rotax_2.Transform, X3=move.Transform)  # -> out, X
# ---------- python_5: Python ----------
X = X3 * X2 * X1
print X
# ---------- end python_5 ----------
transform = Transform(Geometry=item, Transform=python_5.X)
rad_2 = Radians(Degrees=Slider(92, range=-180..180))
mesh = Mesh([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])
python_6 = PythonScript(meshes=mesh)  # -> out, m0, m1, m2, m3, m4, m5, m6, L, C; inputs meshes: list
# ---------- python_6: Python ----------
from compas.geometry.xforms import Transformation
from compas.geometry.xforms import Translation
from compas.geometry.xforms import Rotation
from compas.geometry import Frame, add_vectors
from compas_ghpython.geometry import xtransform

import Rhino.Geometry as rg
from System.Drawing import Color

import math

m0, m1, m2, m3, m4, m5, m6 = meshes

def calculate_frame_and_transform(pos_parent, rot_parent, pos, rot, mesh = None):
    
    pos = add_vectors(pos_parent, rot_parent.transform_point(pos))
    rot = rot_parent * rot
    
    f = Frame.from_rotation(rot)
    f.point = pos
    
    
    
    fx = Frame(f.point, f.xaxis, f.zaxis)
    Tx = Transformation.from_frame(fx)
    
    
    
    print f
    #print fx
    #print "============"
    
    if mesh:
        return f, xtransform(mesh, Tx, copy=True)
    else:
        return f

"""
createEntityForGeometryElement( link, *visual->geometry, visual->origin, visual_node_, visual_mesh );
          if( visual_mesh )
"""

pos0 = [0,0,0]
rot0 = Rotation.from_euler_angles([0, 0, 0])
f0 = Frame.from_rotation(rot0)
f0.point = pos0

"""
<link name="base"/>
  <joint name="base_link-base_fixed_joint" type="fixed">
    <origin rpy="0 0 -3.14159265" xyz="0 0 0"/>
    <parent link="base_link"/>
    <child link="base"/>
  </joint>
"""

pos0x = [0.0, 0.0, 0]
rot0x = Rotation.from_euler_angles([0, 0, -3.14159265])
f0x, m0 = calculate_frame_and_transform(f0.point, Rotation.from_frame(f0), pos0x, rot0x, m0)

# for m1, R1, T1
# <joint name="shoulder_pan_joint" type="revolute">
#    <parent link="base_link"/>
#    <child link="shoulder_link"/>
#    <origin rpy="0.0 0.0 0.0" xyz="0.0 0.0 0.089159"/>
#    <axis xyz="0 0 1"/>

pos1 = [0.0, 0.0, 0.089159 * 1000]
rot1 = Rotation.from_euler_angles([0.0, 0, 0.0])
f1, m1 = calculate_frame_and_transform(f0.point, Rotation.from_frame(f0), pos1, rot1, m1)

# <joint name="shoulder_lift_joint" type="revolute">
#    <parent link="shoulder_link"/>
#    <child link="upper_arm_link"/>
#    <origin rpy="0.0 1.570796325 0.0" xyz="0.0 0.13585 0.0"/>
#    <axis xyz="0 1 0"/>

pos2 = [0.0, 0.13585 * 1000, 0.0]
rot2 = Rotation.from_euler_angles([0.0, 1.570796325, 0.0])
f2, m2 = calculate_frame_and_transform(f1.point, Rotation.from_frame(f1), pos2, rot2, m2)

"""
<joint name="elbow_joint" type="revolute">
    <parent link="upper_arm_link"/>
    <child link="forearm_link"/>
    <origin rpy="0.0 0.0 0.0" xyz="0.0 -0.1197 0.425"/>
    <axis xyz="0 1 0"/>
  </joint>
"""

pos3 = [0.0, -0.1197 * 1000, 0.425 * 1000]
rot3 = Rotation.from_euler_angles([0.0, 0.0, 0.0])
f3, m3 = calculate_frame_and_transform(f2.point, Rotation.from_frame(f2), pos3, rot3, m3)

"""
<joint name="wrist_1_joint" type="revolute">
    <parent link="forearm_link"/>
    <child link="wrist_1_link"/>
    <origin rpy="0.0 1.570796325 0.0" xyz="0.0 0.0 0.39225"/>
    <axis xyz="0 1 0"/>
    <limit effort="28.0" lower="-6.2831853" upper="6.2831853" velocity="3.2"/>
    <dynamics damping="0.0" friction="0.0"/>
  </joint>
"""

pos4 = [0.0, 0.0, 0.39225 * 1000]
rot4 = Rotation.from_euler_angles([0.0, 1.570796325, 0.0])
f4, m4 = calculate_frame_and_transform(f3.point, Rotation.from_frame(f3), pos4, rot4, m4)

"""
<joint name="wrist_2_joint" type="revolute">
    <parent link="wrist_1_link"/>
    <child link="wrist_2_link"/>
    <origin rpy="0.0 0.0 0.0" xyz="0.0 0.093 0.0"/>
    <axis xyz="0 0 1"/>
    <limit effort="28.0" lower="-6.2831853" upper="6.2831853" velocity="3.2"/>
    <dynamics damping="0.0" friction="0.0"/>
  </joint>
"""

pos5 = [0.0, 0.093 * 1000, 0.0]
rot5 = Rotation.from_euler_angles([0.0, 0.0, 0.0])
f5, m5 = calculate_frame_and_transform(f4.point, Rotation.from_frame(f4), pos5, rot5, m5)

"""
<joint name="wrist_3_joint" type="revolute">
    <parent link="wrist_2_link"/>
    <child link="wrist_3_link"/>
    <origin rpy="0.0 0.0 0.0" xyz="0.0 0.0 0.09465"/>
    <axis xyz="0 1 0"/>
    <limit effort="28.0" lower="-6.2831853" upper="6.2831853" velocity="3.2"/>
    <dynamics damping="0.0" friction="0.0"/>
  </joint>

"""

pos6 = [0.0, 0.0, 0.09465 * 1000]
rot6 = Rotation.from_euler_angles([0.0, 0.0, 0.0])
f6, m6 = calculate_frame_and_transform(f5.point, Rotation.from_frame(f5), pos6, rot6, m6)


"""
<link name="tool0"/>
  <joint name="wrist_3_link-tool0_fixed_joint" type="fixed">
    <origin rpy="-1.570796325 0 0" xyz="0 0.0823 0"/>
    <parent link="wrist_3_link"/>
    <child link="tool0"/>
  </joint>
"""

pos7 = [0, 0.0823 * 1000, 0]
rot7 = Rotation.from_euler_angles([-1.570796325, 0, 0])
f7 = calculate_frame_and_transform(f6.point, Rotation.from_frame(f6), pos7, rot7)


def draw_frame(frame, scale=100):
    pl = rg.Plane(rg.Point3d(*frame.point), rg.Vector3d(*frame.xaxis), rg.Vector3d(*frame.yaxis))
    x = rg.Line(pl.Origin, pl.XAxis * scale)
    y = rg.Line(pl.Origin, pl.YAxis * scale)
    z = rg.Line(pl.Origin, pl.ZAxis * scale)
    r = Color.FromArgb(255, 0, 0)
    g = Color.FromArgb(0, 255, 0)
    b = Color.FromArgb(0, 0, 255)
    return [x, y, z], [r, g, b]
    
    
l0, c0 = draw_frame(f0)
l1, c1 = draw_frame(f1)
l2, c2 = draw_frame(f2)
l3, c3 = draw_frame(f3)
l4, c4 = draw_frame(f4)
l5, c5 = draw_frame(f5)
l6, c6 = draw_frame(f6)
l7, c7 = draw_frame(f7)

L = l0 + l1 + l2 + l3 + l4 + l5 + l6 + l7
C = c0 + c1 + c2 + c3 + c4 + c5 + c6 + c7
# ---------- end python_6 ----------
preview = CustomPreview(
    Geometry=[python_6.m5, python_6.m4, python_6.m6, python_6.m3, python_6.m2, python_6.m1, python_6.m0],
    Shader=ColourSwatch(SwatchColor=RGBA(158, 158, 158, 139)))
pipe = Pipe(Curve=python_6.L, Radius=1, Caps=0)  # -> flatten(Pipe)
preview_2 = CustomPreview(Geometry=pipe, Shader=python_6.C)
