# Grasshopper definition robot.ghx (Grasshopper 0.9.76)
# plug-ins: Python Interpreter

reload = Button()

panel = Panel("C:\Users\rustr\workspace\robot_description\")
list = ValueList({"ur_description", "abb_irb6640_185_280", "staubli_tx60l", "staubli_tx60_support", "panda", "ur5_with_measurement_tool"}, selected="ur_description")
list_2 = ValueList({"ur_description", "ur10", "abb_irb6640_185_280", "staubli_tx60l", "staubli_tx60", "panda", "ur5_with_measurement_tool"}, selected="ur_description")
py = PythonScript(path=panel, packages=list)  # -> loaders; inputs packages: list
# ---------- py: Python ----------
from compas.robots import LocalPackageMeshLoader

loaders = []
for package in packages:
 loaders.append(LocalPackageMeshLoader(path, package))
# ---------- end py ----------
py_2 = PythonScript(path=panel, package=list_2, urdf_name="ur5.urdf", srdf_name="ur5.srdf")  # -> urdf_filename, srdf_filename
# ---------- py_2: Python ----------
import os

urdf_filename = os.path.join(path, package, "urdf", urdf_name)
srdf_filename = os.path.join(path, package, srdf_name)

assert os.path.isfile(urdf_filename) == True
assert os.path.isfile(srdf_filename) == True
# ---------- end py_2 ----------
units = ValueList({"m": 1, "cm": 100, "mm": 1000}, selected="m")
load = Button()
create = PythonScript(loaders=py, urdf_filename=py_2.urdf_filename, srdf_filename=py_2.srdf_filename, scale_factor=units, load=load)  # -> robot; inputs loaders: list
# ---------- create: Python ----------
import os
from scriptcontext import sticky as st

import compas
from compas.robots import RobotModel
from compas.robots import LocalPackageMeshLoader

from compas_fab.robots import Robot
from compas_fab.robots.semantics import RobotSemantics

from compas_fab.ghpython import RobotArtist

compas.PRECISION = '12f'

# store robot in component
guid = str(ghenv.Component.InstanceGuid)
robot_key = "robot_" + guid

if robot_key not in st:
    st[robot_key] = None

if load:
    model = RobotModel.from_urdf_file(urdf_filename)
    model.load_geometry(*loaders)
    artist = RobotArtist(model)
    semantics = RobotSemantics.from_srdf_file(srdf_filename, model)
    robot = Robot(model, artist, semantics, client=None)

    st[robot_key] = robot

robot = st[robot_key]

if robot:
    robot.scale(scale_factor)
# ---------- end create ----------
robot = Data(create)

# ----
# Scene geometry
panel_2 = Panel("Define an obstacle")
brep = Brep(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)
mesh = Mesh(brep)
preview = CustomPreview(Geometry=brep, Shader=ColourSwatch(SwatchColor=RGB(255, 255, 255)))
mesh_2 = PythonScript(mesh=mesh, scale_factor=units)  # -> compas_mesh
# ---------- mesh_2: Python ----------
import compas
from compas.datastructures import Mesh
from compas.datastructures import mesh_quads_to_triangles
from compas_rhino.helpers import mesh_from_guid

import Rhino.Geometry as rg

S = rg.Transform.Scale(rg.Plane.WorldXY, 1./scale_factor, 1./scale_factor, 1./scale_factor)
mesh.Transform(S)

compas_mesh = mesh_from_guid(Mesh, mesh)
mesh_quads_to_triangles(compas_mesh)
# ---------- end mesh_2 ----------
# Pass collision object to planning scene
panel_3 = Panel("floor")
remove = Button()
add = Button()
collision = PythonScript(robot=robot, compas_mesh=mesh_2, id_name=panel_3, add=add, remove=remove)  # -> out
# ---------- collision: Python ----------
if robot and robot.client:
    if add:
        robot.add_collision_mesh_to_planning_scene(id_name, compas_mesh)
    if remove:
        robot.remove_collision_mesh_from_planning_scene(id_name)
else:
    print("Robot is not connected")
# ---------- end collision ----------
panel_4 = Panel(collision)

# ---- group: ROS client
disconnect = Button()
connect = Button()
restart = Button()
ros = PythonScript(restart=restart)  # -> out, ros_client
# ---------- ros: Python ----------
import sys
import time
import logging
import scriptcontext as sc

from compas_fab.backends import RosClient

from System import TimeSpan
from System.Threading import ManualResetEventSlim

LOGGER = logging.getLogger('roslibpy')

key = 'rosclient_%s' % str(ghenv.Component.InstanceGuid)
previous_client = sc.sticky.get(key, None)
if previous_client:
    previous_client.terminate()

ros_client = RosClient('127.0.0.1', 9090)
sc.sticky[key] = ros_client

waitLock = ManualResetEventSlim(False)

ros_client.on_ready(lambda: waitLock.Set())

if not waitLock.Wait(TimeSpan.FromSeconds(5)):
    raise Exception('Unable to connect to ROS')

LOGGER.info('ROS connection opened')
# ---------- end ros ----------
connect_2 = PythonScript(ros_client=ros.ros_client, connect=connect, disconnect=disconnect)  # -> out, ros_client
# ---------- connect_2: Python ----------
import logging
from System import TimeSpan
from System.Threading import ManualResetEventSlim

LOGGER = logging.getLogger('roslibpy')

if connect:
    if not ros_client.is_connected:
        LOGGER.debug('Connecting...')
        waitLock = ManualResetEventSlim(False)
        ros_client.on_ready(lambda: waitLock.Set())
        ros_client.connect()

        if not waitLock.Wait(TimeSpan.FromSeconds(5)):
            raise Exception('Unable to connect to ROS')
        LOGGER.debug('Reconnected')

if disconnect:
    if ros_client.is_connected:
        ros_client.terminate()
        LOGGER.debug('Terminated')
# ---------- end connect_2 ----------

# ----
py_3 = PythonScript(reload=reload)
# ---------- py_3: Python ----------
from compas_rhino.utilities.misc import get_tolerance
from compas_rhino.utilities.misc import unload_modules

from compas_ghpython import unload_modules
unload_modules("compas")
unload_modules("compas_fab")
unload_modules("roslibpy")
# ---------- end py_3 ----------
remove_2 = Button()
add_2 = Button()

# ----
# Robot
set = PythonScript(robot=robot, client=connect_2.ros_client)
# ---------- set: Python ----------
if robot and client:
    robot.client = client
# ---------- end set ----------

# ----
# Info
info = PythonScript(robot=robot)  # -> out, planning_groups, main_group, base_frame, all_joint_names, main_joint_names
# ---------- info: Python ----------
from compas.robots import Joint

if robot:
    robot.info()
# ---------- end info ----------
panel_5 = Panel(info.out)

# ----
# Configuration
main_planning_group = Text(info.main_group)

# ----
# Create attached collision object
number_slider = Slider(0.053, range=0..0.1)
brick = PythonScript(w=Slider(0.115, range=0..1), d=Slider(0.24, range=0..1), h=number_slider)  # -> brick
# ---------- brick: Python ----------
import Rhino.Geometry as rg


brick = rg.Box(rg.Plane.WorldXY, rg.Interval(-w/2,w/2), rg.Interval(-d/2,d/2), rg.Interval(0,h))
# ---------- end brick ----------
mesh_3 = Mesh(brick)
mesh_4 = PythonScript(mesh=mesh_3, scale_factor=units)  # -> compas_mesh
# ---------- mesh_4: Python ----------
import compas
from compas.datastructures import Mesh
from compas.datastructures import mesh_quads_to_triangles
from compas_rhino.helpers import mesh_from_guid

import Rhino.Geometry as rg

S = rg.Transform.Scale(rg.Plane.WorldXY, 1./scale_factor, 1./scale_factor, 1./scale_factor)
mesh.Transform(S)

compas_mesh = mesh_from_guid(Mesh, mesh)
mesh_quads_to_triangles(compas_mesh)

#filepath = r"C:\Users\rustr\workspace\robotic_assembly_workshop\examples\brick.json"
#compas_mesh.to_json(filepath)
#compas_mesh.to_obj(r"C:\Users\rustr\workspace\robotic_assembly_workshop\examples\brick.obj")
# ---------- end mesh_4 ----------
attached_co = PythonScript(robot=robot, group=main_planning_group, compas_mesh=mesh_4, id_name="brick")  # -> attached_collision_object
# ---------- attached_co: Python ----------
base_link_name = robot.get_base_link_name(group)
ee_name = robot.get_end_effector_link_name(group)
print base_link_name
print ee_name
last_link_with_geometry = None
for link in reversed(list(robot.model.iter_link_chain(base_link_name, ee_name))):
    if len(link.collision) or len(link.visual):
        last_link_with_geometry = link.name
        break
print(last_link_with_geometry)
touch_links = [last_link_with_geometry]

aco = robot.create_collision_mesh_attached_to_end_effector(id_name, compas_mesh, group)
# ---------- end attached_co ----------

collision_2 = PythonScript(robot=robot, group=main_planning_group, compas_mesh=mesh_2, id_name="brick", add=add_2, remove=remove_2)  # -> out
# ---------- collision_2: Python ----------
if robot and robot.client:
    if add:
        robot.add_attached_collision_mesh(id_name, compas_mesh, group, touch_links=[], scale=False)
    if remove:
        robot.remove_attached_collision_mesh(id_name, group)
else:
    print("Robot is not connected")
# ---------- end collision_2 ----------

# ---- group: forward kinematics
a1 = Slider(0, range=-360..360)
a6 = Slider(0, range=-360..360)
a4 = Slider(0, range=-360..360)
a5 = Slider(0, range=-360..360)
a2 = Slider(0, range=-360..360)
a3 = Slider(0, range=-360..360)
forward_kinematics = PythonScript(robot=robot, a1=a1, a2=a2, a3=a3, a4=a4, a5=a5, a6=a6)  # -> configuration
# ---------- forward_kinematics: Python ----------
import math
from compas_fab.robots import Configuration

if robot:
    joint_positions = [a1, a2, a3, a4, a5, a6]
    joint_positions = [math.radians(a) for a in joint_positions]
    types = robot.get_configurable_joint_types()
    configuration = Configuration(joint_positions, types)
    print configuration
# ---------- end forward_kinematics ----------

# ---- group: inverse kinematics
py_4 = PythonScript(robot=robot)  # -> configuration
# ---------- py_4: Python ----------
from compas_fab.robots import Configuration

types = robot.get_configurable_joint_types()
values = [0] * len(types)
values = [-0.042, 4.295, -4.110, -3.327, 4.755, 0.]

configuration = Configuration(values, types)
print configuration
# ---------- end py_4 ----------
pt = Point(Point(0.3, 0.1, 0.5))
xy = XYPlane(Origin=pt)
ik = PythonScript(robot=robot, group=main_planning_group, start_configuration=py_4, plane=xy)  # -> out, configuration, error
# ---------- ik: Python ----------
import scriptcontext as sc
import logging

from compas.geometry import Frame

from compas_fab.backends.ros import MoveItErrorCodes
from compas_fab.robots import Configuration


LOGGER = logging.getLogger('roslibpy')

guid = str(ghenv.Component.InstanceGuid)
response_key = "response_" + guid

if response_key not in sc.sticky:
    sc.sticky[response_key] = None


if robot:
    if robot.client:
        if robot.client.is_connected:
            frame = Frame(plane.Origin, plane.XAxis, plane.YAxis)
            response = robot.inverse_kinematics(frame, start_configuration, group)
            sc.sticky[response_key] = response
        else:
            print("Robot is not connected")

if sc.sticky[response_key]:
    response = sc.sticky[response_key]
    if response.error_code == MoveItErrorCodes.SUCCESS:
        configuration = response.configuration
    error = response.error_code.human_readable
# ---------- end ik ----------
panel_6 = Panel(ik.out)
error = Panel(ik.error)

# ---- group: calculate path
pt_2 = Point(Point(0.2, 0.38, 0.32))
yz = YZPlane(Origin=pt_2)
py_5 = PythonScript(robot=robot)  # -> configuration
# ---------- py_5: Python ----------
from compas_fab.robots import Configuration

types = robot.get_configurable_joint_types()
values = [0] * len(types)

configuration = Configuration(values, types)
print configuration
# ---------- end py_5 ----------
start_configuration = Data(ik.configuration)
list_3 = ValueList({"0", "1"}, selected="0")
avoid_collisions = BooleanToggle(True)
py_6 = PythonScript(start_plane=xy, end_plane=yz)  # -> planes
# ---------- py_6: Python ----------
planes = [start_plane, end_plane]
print planes
# ---------- end py_6 ----------
compute = Button()
filter = StreamFilter(Gate=list_3, Stream0=start_configuration, Stream1=py_5)
compute_path = PythonScript(
    robot=robot,
    start_configuration=filter,
    planes=py_6,
    max_step=Slider(0.01, range=0..0.01),
    avoid_collisions=avoid_collisions,
    compute=compute)  # -> out, response; inputs planes: list, avoid_collisions: Boolean
# ---------- compute_path: Python ----------
import logging
import scriptcontext as sc

from compas.geometry import Frame

from compas_ghpython.utilities import update_component

guid = str(ghenv.Component.InstanceGuid)
response_key = "response_" + guid
if response_key not in sc.sticky:
    sc.sticky[response_key] = None

LOGGER = logging.getLogger('roslibpy')
data = dict(requesting_solution=False)



if robot:
    if robot.client:
        if robot.client.is_connected:
            if start_configuration and compute:
                frames = [Frame(plane.Origin, plane.XAxis, plane.YAxis) for plane in planes]
                response = robot.compute_cartesian_path(frames, start_configuration, float(max_step),
                                             bool(avoid_collisions), group)
                sc.sticky[response_key] = response
                # update_component(ghenv, 100)  # Not needed now that it is sync?
        else:
            print("Robot is not connected")
            sc.sticky[response_key] = None

response = sc.sticky[response_key]
# ---------- end compute_path ----------
vis = PythonScript(response=compute_path.response)  # -> P, V, A, time
# ---------- vis: Python ----------
from compas_ghpython import list_to_ghtree

if response:

    positions = []
    velocities = []
    accelerations = []
    time_from_start = []
    
    for p in response.solution.joint_trajectory.points:
        positions.append(p.positions)
        velocities.append(p.velocities)
        accelerations.append(p.accelerations)
        time_from_start.append(p.time_from_start.seconds())
    
    P = list_to_ghtree(list(zip(*positions)))
    V = list_to_ghtree(list(zip(*velocities)))
    A = list_to_ghtree(list(zip(*accelerations)))
    
    time = time_from_start[-1]
    print time
# ---------- end vis ----------
time_s = Panel(vis.time)
panel_7 = Panel(compute_path.out)
py_7 = PythonScript(response=compute_path.response)  # -> start_configuration, configurations, error, fraction
# ---------- py_7: Python ----------
from compas_fab.backends.ros import MoveItErrorCodes

joint_positions = []

if response:
    if response.error_code == MoveItErrorCodes.SUCCESS:
        configurations = response.configurations
        start_configuration = response.start_configuration
    error = response.error_code.human_readable
    fraction = response.fraction
# ---------- end py_7 ----------
error_2 = Panel(py_7.error)
fraction = Panel(py_7.fraction)
prismatic = QuickGraph(vis.P)
panel_8 = Panel("positions")
animate = PythonScript(
    robot=robot,
    start_configuration=py_7.start_configuration,
    configurations=py_7.configurations,
    value=Slider(0, range=0..1))  # -> configuration; inputs configurations: list
# ---------- animate: Python ----------
from compas_fab.utilities import map_range
from compas_fab.robots import Configuration

count = len(configurations)
if count and robot and configurations != [None]:
    idx = int(map_range(value, 0, 1, 0, count - 1))
    current_configuration = configurations[idx]
    #make full configuration
    configuration = robot.merge_group_with_full_configuration(current_configuration, start_configuration, group)
else:
    configuration = robot.init_configuration()

print configuration
# ---------- end animate ----------
graph = QuickGraph(vis.V)
graph_2 = QuickGraph(vis.A)
panel_9 = Panel("velocities")
panel_10 = Panel("accelerations")

# ---- group: motion plan
# Example:
# Add path constraints
number_slider_2 = Slider(0.7, range=0..5)
py_8 = PythonScript(robot=robot)  # -> configuration; same code as py_5
start_configuration_2 = Data(ik.configuration)
list_4 = ValueList({"0", "1"}, selected="1")
compute_2 = Button()
list_5 = ValueList({"0", "1"}, selected="0")
filter_2 = StreamFilter(Gate=list_4, Stream0=start_configuration_2, Stream1=py_8)
py_9 = PythonScript(robot=robot, start_configuration=filter_2, tol=number_slider_2)  # -> pc
# ---------- py_9: Python ----------
from compas_fab.backends.ros import Constraints
from compas_fab.backends.ros import JointConstraint

pc = Constraints()

name = robot.get_configurable_joint_names()[0]
pos = robot.get_position_by_joint_name(start_configuration, name)/robot.scale_factor
pc.joint_constraints.append(JointConstraint(name, pos, tol, tol, 1.))

print pc
# ---------- end py_9 ----------
filter_3 = StreamFilter(Gate=list_5, Stream1=py_9)
motion_plan = PythonScript(
    robot=robot,
    start_configuration=filter_2,
    goal_plane=yz,
    tolerance_position=Slider(2, range=0..10),
    tolerance_angle_deg=Slider(1, range=0..180),
    path_constraints=filter_3,
    compute=compute_2)  # -> out, response; inputs tolerance_position: Boolean
# ---------- motion_plan: Python ----------
import logging
from scriptcontext import sticky as st
import math
from compas.geometry import Frame

from compas_fab.robots import Configuration

from compas_ghpython.utilities import update_component

guid = str(ghenv.Component.InstanceGuid)
response_key = "response_" + guid
if response_key not in st:
    st[response_key] = None

LOGGER = logging.getLogger('roslibpy')
data = dict(requesting_solution=False)

frame = Frame(goal_plane.Origin, goal_plane.XAxis, goal_plane.YAxis)




if robot and robot.client and robot.client.is_connected and start_configuration and compute:
    tolerance_angle = math.radians(tolerance_angle_deg)
    st[response_key] = robot.motion_plan_goal_frame(frame, 
                                                    start_configuration, 
                                                    float(tolerance_position), 
                                                    tolerance_angle, 
                                                    group, 
                                                    path_constraints=None, 
                                                    trajectory_constraints=None, 
                                                    planner_id='RRT',
                                                    num_planning_attempts=10,
                                                    allowed_planning_time=5.,
                                                    attached_collision_object=None)

response = st[response_key]
# ---------- end motion_plan ----------
vis_2 = PythonScript(response=motion_plan.response)  # -> P, V, A, time
# ---------- vis_2: Python ----------
from compas_ghpython import list_to_ghtree

if response:

    positions = []
    velocities = []
    accelerations = []
    time_from_start = []
    
    for p in response.trajectory.joint_trajectory.points:
        positions.append(p.positions)
        velocities.append(p.velocities)
        accelerations.append(p.accelerations)
        time_from_start.append(p.time_from_start.seconds())
    
    P = list_to_ghtree(list(zip(*positions)))
    V = list_to_ghtree(list(zip(*velocities)))
    A = list_to_ghtree(list(zip(*accelerations)))
    
    time = time_from_start[-1]
    print time
# ---------- end vis_2 ----------
time_s_2 = Panel(vis_2.time)
prismatic_2 = QuickGraph(vis_2.P)
py_10 = PythonScript(robot=robot, response=motion_plan.response)  # -> start_configuration, configurations, error
# ---------- py_10: Python ----------
from compas_fab.backends.ros import MoveItErrorCodes
from compas_fab.robots import Configuration
joint_positions = []

if response:
    if response.error_code == MoveItErrorCodes.SUCCESS:
        print response.trajectory_start
        print response.planning_time

        configurations = response.configurations
        start_configuration = response.start_configuration
    error = response.error_code.human_readable




print start_configuration
# ---------- end py_10 ----------
panel_11 = Panel(motion_plan.out)
error_3 = Panel(py_10.error)
animate_2 = PythonScript(
    robot=robot,
    start_configuration=py_10.start_configuration,
    configurations=py_10.configurations,
    value=Slider(0, range=0..1))  # -> configuration; inputs configurations: list; same code as animate
graph_3 = QuickGraph(vis_2.V)
graph_4 = QuickGraph(vis_2.A)

# ---- group: forward kinematics
fk = PythonScript(robot=robot, group=main_planning_group, configuration=ik.configuration)  # -> out, frame_WCF, error
# ---------- fk: Python ----------
import scriptcontext as sc
import logging
import Rhino

from compas_fab.backends.ros import MoveItErrorCodes
from compas_fab.robots import Configuration

LOGGER = logging.getLogger('roslibpy')

guid = str(ghenv.Component.InstanceGuid)
response_key = "response_" + guid

if response_key not in sc.sticky:
    sc.sticky[response_key] = None


if robot:
    if robot.client:
        if robot.client.is_connected:
            configuration = robot.get_group_configuration(group, configuration)
            response = robot.forward_kinematics(configuration, group)
            sc.sticky[response_key] = response
        else:
            print("Robot is not connected")

if sc.sticky[response_key]:
    response = sc.sticky[response_key]
    if response.error_code == MoveItErrorCodes.SUCCESS:
        frame_WCF = response.frame_WCF
    error = response.error_code.human_readable

print frame_WCF
# ---------- end fk ----------
panel_15 = Panel(fk.out)
error_4 = Panel(fk.error)

# ----
# Visualisation
# Select configuration input: from fk, ik, path, or from real robot
list_6 = ValueList({"0 forward_kinematics": 0, "1 inverse_kinematics": 1, "2 calculated_path": 2, "3 motion plan": 3}, selected="1 inverse_kinematics")
filter_4 = StreamFilter(Gate=list_6, Stream0=forward_kinematics, Stream1=ik.configuration, Stream2=animate, Stream3=animate_2)
show_end_effector_frame = BooleanToggle(True)
show_base_frame = BooleanToggle(False)
show_collision = BooleanToggle(False)
show_visual = BooleanToggle(True)
show_axes = BooleanToggle(True)
visualize = PythonScript(
    robot=robot,
    configuration=filter_4,
    show_visual=show_visual,
    show_collision=show_collision,
    show_axes=show_axes,
    show_base_frame=show_base_frame,
    show_end_effector_frame=show_end_effector_frame)  # -> out, visual, collision, axes, axes_color, ee_plane, ee_frame, ee_frame_geo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
# ---------- visualize: Python ----------
from System.Drawing import Color

from compas.geometry import Vector
from compas.geometry import Point
from compas_ghpython.utilities import xdraw_frame
from compas_ghpython.utilities import xdraw_pipes

from compas_fab.robots import Configuration

red = Color.FromArgb(255, 0, 0)
green = Color.FromArgb(0, 255, 0)
blue = Color.FromArgb(0, 0, 255)

frame_colors = [red, green, blue]

# TODO: move to frame artist?
def pipes_from_frame(frame, size, radius):
    pipes = []
    for axis in [frame.xaxis, frame.yaxis, frame.zaxis]:
        pipe = {}
        pipe['points'] = [list(frame.point), list(Point(*frame.point) + Vector(*axis) * size)]
        pipe['radius'] = radius
        pipes.append(pipe)
    return pipes

if robot and configuration:

    robot.update(configuration, collision=show_collision)

    print("Configuration:")
    print(configuration.values)

    if show_visual:
        visual = robot.draw_visual()

    if show_collision:
        collision = robot.draw_collision()

    pipe_size = 0.1 * robot.scale_factor
    pipe_radius = 0.001 * robot.scale_factor
    if show_axes:
        pipes = []
        axes_color = []
        for frame in robot.frames:
            pipes += pipes_from_frame(frame, pipe_size, pipe_radius)
            axes_color += frame_colors
        axes = xdraw_pipes(pipes, cap=1)

    ee_frame = robot.get_end_effector_frame()
    ee_plane = xdraw_frame(ee_frame)

    print("End-effector frame:")
    print(ee_frame)

    if show_end_effector_frame:
        ee_pipes = pipes_from_frame(ee_frame, pipe_size, pipe_radius)
        ee_frame_geo = xdraw_pipes(ee_pipes, cap=1)
        ee_frame_color = frame_colors

    base_frame = robot.get_base_frame()
    base_plane = xdraw_frame(base_frame)

    if show_base_frame:
        base_pipes = pipes_from_frame(base_frame, pipe_size, pipe_radius)
        base_frame_geo = xdraw_pipes(base_pipes, cap=1)
        base_frame_color = frame_colors
# ---------- end visualize ----------
preview_2 = CustomPreview(Geometry=visualize.axes, Shader=visualize.axes_color)
preview_3 = CustomPreview(Geometry=visualize.ee_frame_geo, Shader=visualize.ee_frame_color)
preview_4 = CustomPreview(Geometry=visualize.base_frame_geo, Shader=visualize.base_frame_color)
geo = Geometry(visualize.visual)
geo_2 = Geometry(visualize.collision)
panel_16 = Panel(visualize.out)
