# Grasshopper definition robot.ghx (Grasshopper 0.9.76)
# plug-ins: Python Interpreter

reload = Button()
start_timer = Button()
stop_timer = Button()

# ---- group: client
# ROS
disconnect = Button()
connect = Button()
restart = Button()
ros = PythonScript(restart=restart)  # -> ros_client
# ---------- ros: Python ----------
import time
import logging
import scriptcontext as sc

from roslibpy import Ros
from System import TimeSpan
from System.Threading import ManualResetEventSlim

LOGGER = logging.getLogger('roslibpy')

key = 'rosclient_%s' % str(ghenv.Component.InstanceGuid)
previous_client = sc.sticky.get(key, None)
if previous_client:
    previous_client.terminate()

ros_client = Ros('127.0.0.1', 9090)
sc.sticky[key] = ros_client

waitLock = ManualResetEventSlim(False)

ros_client.on_ready(lambda: waitLock.Set())

if not waitLock.Wait(TimeSpan.FromSeconds(5)):
    raise Exception('Unable to connect to ROS')

LOGGER.info('ROS connection opened')
# ---------- end ros ----------
connect_2 = PythonScript(ros_client=ros, connect=connect, disconnect=disconnect)  # -> out, ros_client
# ---------- connect_2: Python ----------
import logging
from System import TimeSpan
from System.Threading import ManualResetEventSlim

LOGGER = logging.getLogger('roslibpy')

if connect:
    if not ros_client.is_connected:
        LOGGER.debug('Connecting...')
        waitLock = ManualResetEventSlim(False)
        ros_client.on_ready(lambda: waitLock.Set())
        ros_client.connect()

        if not waitLock.Wait(TimeSpan.FromSeconds(5)):
            raise Exception('Unable to connect to ROS')
        LOGGER.debug('Reconnected')

if disconnect:
    if ros_client.is_connected:
        ros_client.terminate()
        LOGGER.debug('Terminated')
# ---------- end connect_2 ----------

# ----
# Settings
# 1. Set the robot model
# 2. Set tool
# 3. Set the base
panel = Panel("C:\Users\rustr\workspace\robot_description\")
list = ValueList({"ur3", "ur5", "ur10", "abb_irb6640_185_280", "staubli_tx60l", "panda"}, selected="ur5")
path = PythonScript(path=panel, robot_name=list)  # -> path
# ---------- path: Python ----------
import os

path = os.path.join(os.path.abspath(path), robot_name)

assert(os.path.isdir(path))
# ---------- end path ----------
create = Button()
create_2 = PythonScript(path=path, create=create)  # -> robot
# ---------- create_2: Python ----------
from scriptcontext import sticky as st

from compas_fab.robots import Robot

from compas_ghpython import mesh_draw
from compas_ghpython.geometry import xform_from_transformation

# store data in component
guid = str(ghenv.Component.InstanceGuid)
robot_key = "robot_" + guid

if robot_key not in st:
    st[robot_key] = None

class Mesh(object):

    def __init__(self, mesh):
        self.mesh = mesh_draw(mesh)

    def transform(self, transformation):
        T = xform_from_transformation(transformation)
        self.mesh.Transform(T)
    
    def draw(self):
        return self.mesh

if create:
    st[robot_key] = Robot(path)
    st[robot_key].create(Mesh)

robot = st[robot_key]
# ---------- end create_2 ----------
set = PythonScript(robot=create_2, client=connect_2.ros_client)  # -> robot
# ---------- set: Python ----------
robot.set_client(client)
# ---------- end set ----------
robot = Data(set)

py = PythonScript(reload=reload)
# ---------- py: Python ----------
from compas_rhino.utilities.misc import get_tolerance
from compas_rhino.utilities.misc import unload_modules

from compas_ghpython import unload_modules
unload_modules("compas")
unload_modules("compas_fab")
# ---------- end py ----------
python = GhPythonScript(start_timer=start_timer, stop_timer=stop_timer)  # -> out, a
# ---------- python: Python ----------
import scriptcontext as sc
from compas_ghpython.utilities import update_component

guid = str(ghenv.Component.InstanceGuid)
timer_running_key = "timer_running_" + guid


if stop_timer or timer_running_key not in sc.sticky:
    sc.sticky[timer_running_key] = False

if start_timer:
    sc.sticky[timer_running_key] = True

if sc.sticky[timer_running_key]:
    update_component(ghenv, 1000)

if 'message' in sc.sticky:
    print sc.sticky['message']
    print sc.sticky['message']
# ---------- end python ----------
panel_2 = Panel(connect_2.out)
panel_3 = Panel(python.out)

# ---- group: calculate path
pt = Point(Point(104.1720096, -294.6809726, 184.3890966))
pt_2 = Point(Point(106.8325585, -181.8061359, 593.0359261))
xy = XYPlane(Origin=pt)
xz = XZPlane(Origin=pt_2)
py_2 = PythonScript(start_plane=xz, end_plane=xy)  # -> waypoints
# ---------- py_2: Python ----------
from compas_fab.robots.backends.ros import Pose


start_pose = Pose([106.8, -181.8, 593.0], [1., 0., 0.], [-0., 0., 1.])
end_pose = Pose([104.1, -294.6, 184.3], [1., 0., 0.], [0., 1., 0.])
waypoints = [start_pose, end_pose]
# ---------- end py_2 ----------
reqmsg = PythonScript(robot=robot, waypoints=py_2)  # -> reqmsg; inputs waypoints: list
# ---------- reqmsg: Python ----------
import math

from compas_fab.robots.backends.ros import Header
from compas_fab.robots.backends.ros import Pose
from compas_fab.robots.backends.ros import PoseStamped
from compas_fab.robots.backends.ros import JointState
from compas_fab.robots.backends.ros import MultiDOFJointState
from compas_fab.robots.backends.ros import RobotState
from compas_fab.robots.backends.ros import GetCartesianPathRequest


if robot:
    
    base_link = robot.get_base_link_name()
    ee_link = robot.get_end_effector_link_name()
    main_planning_group = robot.main_planning_group
    joint_names = robot.get_configurable_joint_names()
    configuration = robot.get_configuration()
    joint_positions = [math.radians(d) for d in configuration]
    header = Header(frame_id=base_link)
    joint_state = JointState(header=header, name=joint_names, position=position)
    multi_dof_joint_state = MultiDOFJointState(header=header, joint_names=joint_names)
    start_state = RobotState(joint_state=joint_state, multi_dof_joint_state=multi_dof_joint_state)
    
    reqmsg = GetCartesianPathRequest(header=header,
                                     start_state=start_state,
                                     group_name=main_planning_group,
                                     link_name=ee_link,
                                     waypoints=waypoints,
                                     max_step=10.,
                                     avoid_collisions=True)
    print(reqmsg)
# ---------- end reqmsg ----------
compute = Button()
compute_path = PythonScript(robot=robot, reqmsg=reqmsg, compute=compute)  # -> response
# ---------- compute_path: Python ----------
import scriptcontext as sc

import logging
import roslibpy

from compas_fab.robots.backends.ros import GetCartesianPathResponse
from compas_fab.robots.backends.ros import MoveItErrorCodes

guid = str(ghenv.Component.InstanceGuid)
response_key = "response_" + guid
if response_key not in sc.sticky:
    sc.sticky[response_key] = None

LOGGER = logging.getLogger('roslibpy')
data = dict(requesting_solution=False)

def receive_message(msg):
    response = GetCartesianPathResponse.from_msg(msg)
    sc.sticky[response_key] = response
    update_component(ghenv, 1)

if robot:
    if robot.client:
        if robot.client.is_connected and compute:
            srv = roslibpy.Service(ros_client, '/compute_cartesian_path', 'GetCartesianPath')
            request = roslibpy.ServiceRequest(reqmsg.msg)
            srv.call(request, receive_message, receive_message)

    else:
        LOGGER.debug('Not connected')
else:
    LOGGER.debug('No ROS client found')

response = sc.sticky[response_key]
# ---------- end compute_path ----------

# ----
# TODO
# 2. Set tool
# 3. Set the base
list_2 = ValueList({"no_tool": 0, "measurement_tool": 1, "gripper": 2}, selected="gripper")
tools = Tools(tool_id=list_2)
base = PythonScript()  # -> base_frame
# ---------- base: Python ----------
from compas_fab.geometry import Frame

"""
origin = [-478.32, -214.49, -194.35]
xaxis = [0.00832, 0.99996, -0.00275]
yaxis = [-0.99990, 0.00835, 0.01182]

"""
origin = [0, 0, 0]
xaxis = [1, 0, 0]
yaxis = [0, 1, 0]

base_frame = Frame(list(origin), list(xaxis), list(yaxis))
# ---------- end base ----------

# ---- group: inverse kinematics
pt_3 = Point(Point(357.6883603, 8.240063073, 495.0008148))
xy_2 = XYPlane(Origin=pt_3)
reqmsg_2 = PythonScript(robot=robot, plane=xy_2)  # -> reqmsg
# ---------- reqmsg_2: Python ----------
import math

from compas_fab.robots.backends.ros import Header
from compas_fab.robots.backends.ros import Pose
from compas_fab.robots.backends.ros import PoseStamped
from compas_fab.robots.backends.ros import JointState
from compas_fab.robots.backends.ros import MultiDOFJointState
from compas_fab.robots.backends.ros import RobotState
from compas_fab.robots.backends.ros import PositionIKRequest
from compas_fab.robots.backends.ros import GetPositionIKRequest

if robot:
    
    base_link = robot.get_base_link_name()
    planning_group = robot.main_planning_group
    pose = Pose(plane.Origin, plane.XAxis, plane.YAxis)
    joint_names = robot.get_configurable_joint_names()
    configuration = robot.get_configuration()
    joint_positions = [math.radians(d) for d in configuration]
    header = Header(frame_id=base_link)
    pose_stamped = PoseStamped(header, pose)
    joint_state = JointState(name=joint_names, position=joint_positions, header=header)
    multi_dof_joint_state = MultiDOFJointState(header=header, joint_names=joint_names)
    start_state = RobotState(joint_state, multi_dof_joint_state)
    ik_request = PositionIKRequest(group_name=planning_group,
                                   robot_state=start_state,
                                   pose_stamped=pose_stamped,
                                   avoid_collisions=True)
    reqmsg = GetPositionIKRequest(ik_request)
    print(reqmsg)
# ---------- end reqmsg_2 ----------
ik = PythonScript(robot=robot, reqmsg=reqmsg_2)
# ---------- ik: Python ----------
import scriptcontext as sc
import logging
import roslibpy

import scriptcontext as sc
from compas_ghpython.utilities import update_component

from compas_fab.robots.backends.ros import GetPositionIKResponse
from compas_fab.robots.backends.ros import MoveItErrorCodes

LOGGER = logging.getLogger('roslibpy')

def receive_message(msg):
    response = GetPositionIKResponse.from_msg(msg)
    if response.error_code == MoveItErrorCodes.SUCCESS:
        configuration = response.solution.joint_state.position
        robot.update(configuration)
        if "drawing_component" in sc.sticky:
            dc_ghenv = sc.sticky["drawing_component"]
            update_component(dc_ghenv, 1)

if robot:
    if robot.client:
        if robot.client.is_connected:
            srv = roslibpy.Service(ros_client, '/compute_ik', 'GetPositionIK')
            request = roslibpy.ServiceRequest(reqmsg.msg)
            srv.call(request, receive_message, receive_message)
    else:
        LOGGER.debug('Not connected')
else:
    LOGGER.debug('No ROS client found')
# ---------- end ik ----------

# ---- group: forward kinematics
forward_kinematics = PythonScript(
    robot=robot,
    s1=Slider(175, range=-360..360),
    s2=Slider(-37, range=-360..360),
    s3=Slider(-117, range=-360..360),
    s4=Slider(-58, range=-360..360),
    s5=Slider(-44, range=-360..360),
    s6=Slider(-14, range=-360..360))
# ---------- forward_kinematics: Python ----------
import math

import scriptcontext as sc
from compas_ghpython.utilities import update_component

if robot:
    positions = [math.radians(s) for s in [s1, s2, s3, s4, s5, s6]]
    robot.update(positions)
    if "drawing_component" in sc.sticky:
        dc_ghenv = sc.sticky["drawing_component"]
        update_component(dc_ghenv, 1)
# ---------- end forward_kinematics ----------

# ----
mesh = Mesh([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])
python_2 = PythonScript(meshes=mesh)  # -> out, m0, m1, m2, m3, m4, m5, m6, L, C; inputs meshes: list
# ---------- python_2: Python ----------
from compas.geometry.xforms import Transformation
from compas.geometry.xforms import Translation
from compas.geometry.xforms import Rotation
from compas.geometry import Frame, add_vectors, Point
from compas_ghpython.geometry import xtransform

import Rhino.Geometry as rg
from System.Drawing import Color

import math

m0, m1, m2, m3, m4, m5, m6 = meshes

def calculate_frame_and_transform(pos_parent, rot_parent, pos, rot, mesh = None):
    
    
    rotated_point = Point(*pos)
    rotated_point.transform(rot_parent.matrix)
    pos = add_vectors(pos_parent, rotated_point)
    
    #pos = add_vectors(pos_parent, rot_parent.transform_point(pos))
    rot = rot_parent * rot
    
    f = Frame.from_rotation(rot)
    f.point = pos
    
    
    
    fx = Frame(f.point, f.xaxis, f.zaxis)
    Tx = Transformation.from_frame(fx)
    
    
    
    print f
    #print fx
    #print "============"
    
    if mesh:
        mesh_cp = mesh.Duplicate()
        xtransform(mesh_cp, Tx)
        #return f, xtransform(mesh, Tx, copy=True)
        return f, mesh_cp
    else:
        return f

"""
createEntityForGeometryElement( link, *visual->geometry, visual->origin, visual_node_, visual_mesh );
          if( visual_mesh )
"""

pos0 = [0,0,0]
rot0 = Rotation.from_euler_angles([0, 0, 0])
f0 = Frame.from_rotation(rot0)
f0.point = pos0

"""
<link name="base"/>
  <joint name="base_link-base_fixed_joint" type="fixed">
    <origin rpy="0 0 -3.14159265" xyz="0 0 0"/>
    <parent link="base_link"/>
    <child link="base"/>
  </joint>
"""

pos0x = [0.0, 0.0, 0]
rot0x = Rotation.from_euler_angles([0, 0, -3.14159265])
f0x, m0 = calculate_frame_and_transform(f0.point, Rotation.from_frame(f0), pos0x, rot0x, m0)

# for m1, R1, T1
# <joint name="shoulder_pan_joint" type="revolute">
#    <parent link="base_link"/>
#    <child link="shoulder_link"/>
#    <origin rpy="0.0 0.0 0.0" xyz="0.0 0.0 0.089159"/>
#    <axis xyz="0 0 1"/>

pos1 = [0.0, 0.0, 0.089159 * 1000]
rot1 = Rotation.from_euler_angles([0.0, 0, 0.0])
f1, m1 = calculate_frame_and_transform(f0.point, Rotation.from_frame(f0), pos1, rot1, m1)

# <joint name="shoulder_lift_joint" type="revolute">
#    <parent link="shoulder_link"/>
#    <child link="upper_arm_link"/>
#    <origin rpy="0.0 1.570796325 0.0" xyz="0.0 0.13585 0.0"/>
#    <axis xyz="0 1 0"/>

pos2 = [0.0, 0.13585 * 1000, 0.0]
rot2 = Rotation.from_euler_angles([0.0, 1.570796325, 0.0])
f2, m2 = calculate_frame_and_transform(f1.point, Rotation.from_frame(f1), pos2, rot2, m2)

"""
<joint name="elbow_joint" type="revolute">
    <parent link="upper_arm_link"/>
    <child link="forearm_link"/>
    <origin rpy="0.0 0.0 0.0" xyz="0.0 -0.1197 0.425"/>
    <axis xyz="0 1 0"/>
  </joint>
"""

pos3 = [0.0, -0.1197 * 1000, 0.425 * 1000]
rot3 = Rotation.from_euler_angles([0.0, 0.0, 0.0])
f3, m3 = calculate_frame_and_transform(f2.point, Rotation.from_frame(f2), pos3, rot3, m3)

"""
<joint name="wrist_1_joint" type="revolute">
    <parent link="forearm_link"/>
    <child link="wrist_1_link"/>
    <origin rpy="0.0 1.570796325 0.0" xyz="0.0 0.0 0.39225"/>
    <axis xyz="0 1 0"/>
    <limit effort="28.0" lower="-6.2831853" upper="6.2831853" velocity="3.2"/>
    <dynamics damping="0.0" friction="0.0"/>
  </joint>
"""

pos4 = [0.0, 0.0, 0.39225 * 1000]
rot4 = Rotation.from_euler_angles([0.0, 1.570796325, 0.0])
f4, m4 = calculate_frame_and_transform(f3.point, Rotation.from_frame(f3), pos4, rot4, m4)

"""
<joint name="wrist_2_joint" type="revolute">
    <parent link="wrist_1_link"/>
    <child link="wrist_2_link"/>
    <origin rpy="0.0 0.0 0.0" xyz="0.0 0.093 0.0"/>
    <axis xyz="0 0 1"/>
    <limit effort="28.0" lower="-6.2831853" upper="6.2831853" velocity="3.2"/>
    <dynamics damping="0.0" friction="0.0"/>
  </joint>
"""

pos5 = [0.0, 0.093 * 1000, 0.0]
rot5 = Rotation.from_euler_angles([0.0, 0.0, 0.0])
f5, m5 = calculate_frame_and_transform(f4.point, Rotation.from_frame(f4), pos5, rot5, m5)

"""
<joint name="wrist_3_joint" type="revolute">
    <parent link="wrist_2_link"/>
    <child link="wrist_3_link"/>
    <origin rpy="0.0 0.0 0.0" xyz="0.0 0.0 0.09465"/>
    <axis xyz="0 1 0"/>
    <limit effort="28.0" lower="-6.2831853" upper="6.2831853" velocity="3.2"/>
    <dynamics damping="0.0" friction="0.0"/>
  </joint>

"""

pos6 = [0.0, 0.0, 0.09465 * 1000]
rot6 = Rotation.from_euler_angles([0.0, 0.0, 0.0])
f6, m6 = calculate_frame_and_transform(f5.point, Rotation.from_frame(f5), pos6, rot6, m6)


"""
<link name="tool0"/>
  <joint name="wrist_3_link-tool0_fixed_joint" type="fixed">
    <origin rpy="-1.570796325 0 0" xyz="0 0.0823 0"/>
    <parent link="wrist_3_link"/>
    <child link="tool0"/>
  </joint>
"""

pos7 = [0, 0.0823 * 1000, 0]
rot7 = Rotation.from_euler_angles([-1.570796325, 0, 0])
f7 = calculate_frame_and_transform(f6.point, Rotation.from_frame(f6), pos7, rot7)


def draw_frame(frame, scale=100):
    pl = rg.Plane(rg.Point3d(*frame.point), rg.Vector3d(*frame.xaxis), rg.Vector3d(*frame.yaxis))
    x = rg.Line(pl.Origin, pl.XAxis * scale)
    y = rg.Line(pl.Origin, pl.YAxis * scale)
    z = rg.Line(pl.Origin, pl.ZAxis * scale)
    r = Color.FromArgb(255, 0, 0)
    g = Color.FromArgb(0, 255, 0)
    b = Color.FromArgb(0, 0, 255)
    return [x, y, z], [r, g, b]


F = [f0, f1, f2, f3, f4, f5, f6, f7]
    
print F


l0, c0 = draw_frame(f0)
l1, c1 = draw_frame(f1)
l2, c2 = draw_frame(f2)
l3, c3 = draw_frame(f3)
l4, c4 = draw_frame(f4)
l5, c5 = draw_frame(f5)
l6, c6 = draw_frame(f6)
l7, c7 = draw_frame(f7)

L = l0 + l1 + l2 + l3 + l4 + l5 + l6 + l7
C = c0 + c1 + c2 + c3 + c4 + c5 + c6 + c7
# ---------- end python_2 ----------
preview = CustomPreview(
    Geometry=[python_2.m5, python_2.m4, python_2.m6, python_2.m3, python_2.m2, python_2.m1, python_2.m0],
    Shader=ColourSwatch(SwatchColor=RGBA(158, 158, 158, 139)))
pipe = Pipe(Curve=python_2.L, Radius=1, Caps=0)  # -> flatten(Pipe)
# Visualisation
# Select the input for the visualisation of the robot:
# 
# 0: forward, from angles
# 1: inverse, from one plane
# 2: inverse, from multiple planes
# 3: forward, from robot
visualize = PythonScript(robot=robot)  # -> visual, collision, frames, frames_color, ee_frame, ee_color, base_frame, base_color, pose_quaternion
# ---------- visualize: Python ----------
from System.Drawing import Color

from compas.geometry import Vector
from compas.geometry import Point
from compas_ghpython.utilities import xdraw_frame
from compas_ghpython.utilities import xdraw_pipes

import scriptcontext as sc
sc.sticky["drawing_component"] = ghenv

frames = []

size = 100
radius = 1

red = Color.FromArgb(255, 0, 0)
green = Color.FromArgb(0, 255, 0)
blue = Color.FromArgb(0, 0, 255)

frame_colors = [red, green, blue]

def pipes_from_frame(frame, size, radius): 
    pipes = []
    for axis in [frame.xaxis, frame.yaxis, frame.zaxis]:
        pipe = {}
        pipe['points'] = [list(frame.point), list(Point(*frame.point) + Vector(*axis) * size)]
        pipe['radius'] = radius
        pipes.append(pipe)
    return pipes

if robot:
    visual = robot.draw_visual()
    collision = robot.draw_collision()
    frames = robot.get_frames()
    print len(frames)
    print frames
    axes = robot.get_axes() # what to do with them?
    ee_frame = robot.get_end_effector_frame()
    base_frame = robot.get_base_frame()
    
    print robot.semantics
    
    print robot.get_base_link().name
    print base_frame
    
    pipes = []
    frames_color = []
    for frame in frames:
        pipes += pipes_from_frame(frame, size, radius)
        frames_color += frame_colors
    frames = xdraw_pipes(pipes, cap=1)
        
    
    ee_pose = Pose.from_frame(ee_frame)
    ee_pipes = pipes_from_frame(ee_frame, size, radius)
    ee_frame = xdraw_pipes(ee_pipes, cap=1)
    ee_color = frame_colors
    
    base_pipes = pipes_from_frame(base_frame, size, radius)
    base_frame = xdraw_pipes(base_pipes, cap=1)
    base_color = frame_colors
    
    pose_quaternion = ee_pose.pose_quaternion
    pose_quaternion = ", ".join(["%.3f" % f for f in pose_quaternion])
# ---------- end visualize ----------

py_3 = PythonScript(path_response=compute_path)  # -> configurations, error
# ---------- py_3: Python ----------
from compas_fab.robots.backends.ros import MoveItErrorCodes

if path_response.error_code == MoveItErrorCodes.SUCCESS:
    start_position = path_response.start_state.joint_state.position
    print(start_joint_state)
    positions = []
    for point in path_response.solution.joint_trajectory.points:
        positions.append(point.positions)
    positions = [start_position] + positions
    configurations = positions
else:
    configurations = []

error = path_response.error_code.human_readable
# ---------- end py_3 ----------
error = Panel(py_3.error)
start = Button()
stop = Button()
animate = PythonScript(robot=robot, start=start, stop=stop, configurations=py_3.configurations)  # inputs configurations: list
# ---------- animate: Python ----------
import scriptcontext as sc
from compas_ghpython.utilities import update_component

guid = str(ghenv.Component.InstanceGuid)
timer_running_key = "timer_running_" + guid
counter_key = "counter_" + guid

if stop or timer_running_key not in sc.sticky:
    sc.sticky[timer_running_key] = False
    sc.sticky[counter_key] = 0

if start:
    sc.sticky[timer_running_key] = True

if len(configurations) and robot:
    current_idx = sc.sticky[counter_key] % len(configurations)
    configuration = configurations[current_idx]
    robot.update(configuration)
    sc.sticky[counter_key] += 1
    if sc.sticky[timer_running_key]:
        update_component(ghenv, 100)
# ---------- end animate ----------

panel_4 = Panel(visualize.pose_quaternion)
preview_2 = CustomPreview(Geometry=pipe, Shader=python_2.C)
geo = Geometry(visualize.visual)
geo_2 = Geometry(visualize.collision)
preview_3 = CustomPreview(Geometry=visualize.frames, Shader=visualize.frames_color)
preview_4 = CustomPreview(Geometry=visualize.base_frame, Shader=visualize.base_color)
preview_5 = CustomPreview(Geometry=visualize.ee_frame, Shader=visualize.ee_color)
colour_swatch = ColourSwatch(SwatchColor=RGB(255, 255, 255))
panel_5 = Panel("get_end_effector_frame(self)")

# ==== cluster Tools
tool_id = ClusterInput()

test_geometry = Geometry([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])
yaxis_line = Curve(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)
xaxis_line = Curve(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)
mesh = Mesh(test_geometry)
brep = Brep(test_geometry)
tool = Tool(meshes=mesh, breps=brep, xline=xaxis_line, yline=yaxis_line)

# ---- group: measurement tool
measurement_tool_geo = Geometry([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])
tool_2 = PythonScript(breps=measurement_tool_geo)  # -> tool; inputs breps: list
# ---------- tool_2: Python ----------
from compas_fab.fab.robots.ur.tools import MeasurementTool
from compas_fab.fab.grasshopper.helpers import draw_mesh

tool = MeasurementTool()
tool.load_model(xdraw_function=draw_mesh)
tool.breps = breps
# ---------- end tool_2 ----------

# ----
tool_id_2 = Integer(tool_id)
tool_3 = PythonScript()  # -> tool
# ---------- tool_3: Python ----------
from compas_fab.fab.geometry import Frame
from compas_fab.fab.robots import Tool

tcp_frame = Frame.worldXY()

tool = Tool(tcp_frame)
tool.model = []
tool.breps = []
# ---------- end tool_3 ----------
filter = StreamFilter(Gate=tool_id_2, Stream0=tool_3, Stream1=tool_2, Stream2=tool)
py = PythonScript(tool=filter)  # -> tcp_frame, model
# ---------- py: Python ----------
tcp_frame = tool.tcp_frame
model = tool.model
# ---------- end py ----------
tool_4 = Data(filter)
draw = PythonScript(frame=py.tcp_frame)  # -> G, C
# ---------- draw: Python ----------
import Rhino.Geometry as rg
from System.Drawing import Color

if not size:
    size = 100

if frame:
    
    plane = rg.Plane(rg.Point3d(*frame.point), rg.Vector3d(*frame.xaxis), rg.Vector3d(*frame.yaxis))

    G = []
    G.append(rg.Line(plane.Origin, size * plane.XAxis))
    G.append(rg.Line(plane.Origin, size * plane.YAxis))
    G.append(rg.Line(plane.Origin, size * plane.ZAxis))
    
    C = []
    C.append(Color.FromArgb(255, 0, 0))
    C.append(Color.FromArgb(0, 255, 0))
    C.append(Color.FromArgb(0, 0, 255))
# ---------- end draw ----------
tool_5 = ClusterOutput(tool_4)
preview = CustomPreview(Geometry=draw.G, Shader=draw.C)
preview_2 = CustomPreview(Geometry=py.model, Shader=ColourSwatch(SwatchColor=RGB(141, 170, 178)))

# ==== cluster Tool
breps = ClusterInput()
meshes = ClusterInput()
meshes_2 = Mesh(meshes)
mjoin = MeshJoin(Meshes=meshes_2)
xline = ClusterInput()
yline = ClusterInput()
tool = PythonScript(meshes=mjoin, breps=breps, xline=xline, yline=yline)  # -> tool; inputs meshes: list of Mesh, breps: list of Brep
# ---------- tool: Python ----------
import Rhino.Geometry as rg
from compas_fab.fab.geometry import Frame
from compas_fab.fab.robots import Tool
from compas.datastructures.mesh import Mesh

xaxis = rg.Line(xline.PointAtStart, xline.PointAtEnd)
yaxis = rg.Line(yline.PointAtStart, yline.PointAtEnd)

if xaxis.From.DistanceTo(yaxis.From) < 0.01:
    origin = xaxis.From
    xaxis = xaxis.Direction
    yaxis = yaxis.Direction
elif xaxis.To.DistanceTo(yaxis.To) < 0.01:
    origin = xaxis.To
    xaxis = -xaxis.Direction
    yaxis = -yaxis.Direction
elif xaxis.From.DistanceTo(yaxis.To) < 0.01:
    origin = xaxis.From
    xaxis = xaxis.Direction
    yaxis = -yaxis.Direction
elif xaxis.To.DistanceTo(yaxis.From) < 0.01:
    origin = xaxis.To
    xaxis = -xaxis.Direction
    yaxis = yaxis.Direction

xaxis.Unitize()
yaxis.Unitize()

print origin
print xaxis
print yaxis

tcp_frame = Frame(origin, xaxis, yaxis)

tool = Tool(tcp_frame)
tool.model = meshes
tool.breps = breps
# ---------- end tool ----------
tool_2 = ClusterOutput(tool)
