# Grasshopper definition model.gh (Grasshopper 0.9.76)
# plug-ins: Python Interpreter

# ---- group: Define path
# set path
# set path
# set path
# set path
# set path
# set path
# set path
# force
# force
# force
# force
# force
# force
# angleA
# angleA
# angleA
# angleA
# angleA
# angleA
# angleB
# angleB
# angleB
# angleB
# angleB
# angleB
# speed
# speed
# speed
# speed
# speed
# speed
# force
# force
# force
# force
# force
# force
# angleA
# angleA
# angleA
# angleA
# angleA
# angleA
# angleA
# angleA
# angleA
# angleA
# angleA
# angleA
# angleA
# angleB
# angleB
# angleB
# angleB
# angleB
# angleB
# speed
# speed
# speed
# speed
# speed
# speed
# speed
# speed
# speed
# speed
# speed
# speed
# speed
# data for further calculation
# data for further calculation
# data for further calculation
# data for further calculation
# data for further calculation
# data for further calculation
# angleA
# angleB
# speed
# force
# angleA
# angleB
# speed
# Planning
# material resistance
# angleA
# material resistance
# angleB
# force
# speed
# angleA
# angleB
# force
# speed
# angleA
# angleB
# force
# speed
# angleA
# angleB
# speed
# material resistance
# force
# angleA
# angleB
# speed
# force
# angleA
# angleB
# speed
# material resistance
# material resistance
# material resistance
# force
# force
# force
# angleA
# angleA
# angleA
# angleB
# angleB
# angleB
# speed
# speed
# speed
# force
# force
# force
# angleA
# angleA
# angleA
# angleB
# angleB
# angleB
# speed
# speed
# speed
number = Slider(30, range=0..100)
Z = UnitZ(Factor=1)
crv = Curve(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)
py = PythonScript(crv=crv, number=number, normal=Z)  # -> planes
# ---------- py: Python ----------
import Rhino.Geometry as rg

normal.Unitize()

# 1. Divide curve
params = rg.Curve.DivideByCount(crv, number - 1, True)
planes = []
for param in params:
    point = rg.Curve.PointAt(crv, param)
    tangent = rg.Curve.TangentAt(crv, param)
    tangent.Unitize()
    # tangent = xaxis, normal is given, so we calculate yaxis
    yaxis = rg.Vector3d.CrossProduct(normal, tangent)
    yaxis.Unitize()
    planes.append(rg.Plane(point, tangent, yaxis))
    
print len(params)
# ---------- end py ----------

# ---- group: Robot
# Settings
# 1. Set the robot model
# 2. Set tool
# 3. Set the base
list = ValueList({"no_tool": 0, "measurement_tool": 1, "gripper": 2}, selected="gripper")
# angleB
# speed
# data for further calculation
# material resistance
# force
list_2 = ValueList({"UR5", "UR10"}, selected="UR10")
py_2 = PythonScript(model=list_2)  # -> n
# ---------- py_2: Python ----------
if model == "UR5":
    n = 0
if model == "UR10":
    n = 1

print n
# ---------- end py_2 ----------
ur10_brep = UR10Brep([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])
ur5_brep = UR5Brep([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])
tools = Tools(tool_id=list)
base = PythonScript()  # -> base_frame
# ---------- base: Python ----------
from compas_fab.fab.geometry import Frame

"""
origin = [-478.32, -214.49, -194.35]
xaxis = [0.00832, 0.99996, -0.00275]
yaxis = [-0.99990, 0.00835, 0.01182]

"""
origin = [0, 0, 0]
xaxis = [1, 0, 0]
yaxis = [0, 1, 0]

base_frame = Frame(list(origin), list(xaxis), list(yaxis))
# ---------- end base ----------
filter = StreamFilter(Gate=py_2, Stream0=ur5_brep, Stream1=ur10_brep)
robot = PythonScript(model=list_2, breps=filter, tool=tools, base_frame=base)  # -> robot; inputs breps: list
# ---------- robot: Python ----------
from compas_fab.fab.robots.ur.ur10 import UR10
from compas_fab.fab.robots.ur.ur5 import UR5
from compas_fab.fab.grasshopper.helpers import draw_mesh
from scriptcontext import sticky as st

if model == "UR5":
    robot = UR5()
elif model == "UR10":
    robot = UR10()

robot.load_model(xdraw_function=draw_mesh)
robot.breps = breps

if tool:
    robot.set_tool(tool)
if base_frame:
    robot.set_base(base_frame)
# ---------- end robot ----------
panel = Panel("workspace")
robot_2 = Data(robot)
ws = PythonScript(robot=robot_2)  # -> S, C
# ---------- ws: Python ----------
import Rhino.Geometry as rg
from compas.geometry.transformations import transform
import ghpythonlib.components as ghcomp

start, end = transform(robot.j0, robot.transformation_RCS_WCS)
start, end = rg.Point3d(*start), rg.Point3d(*end)

dir = end - start
dir.Unitize()

pl = rg.Plane(end - dir * robot.working_area_sphere_diameter/2, dir)

S = rg.Sphere(end, robot.working_area_sphere_diameter/2)
C = rg.Cylinder(rg.Circle(pl, robot.working_area_cylinder_diameter/2), robot.working_area_sphere_diameter)

W = ghcomp.SolidDifference(S, C)

print W
# ---------- end ws ----------
sdiff = SolidDifference(BrepsA=ws.S, BrepsB=ws.C)
preview = CustomPreview(Geometry=sdiff, Shader=ColourSwatch(SwatchColor=RGBA(103, 153, 124, 92)))

# ----
panel_2 = Panel("Unload libraries")
bang = Button()
unload = PythonScript(bang=bang)
# ---------- unload: Python ----------
from compas_fab.fab.grasshopper.utilities import unload_modules

unload_modules("compas")
unload_modules("compas_fab")
# ---------- end unload ----------

# ----
# Visualisation
# Select the input for the visualisation of the robot:
# 
# 0: forward, from angles
# 1: inverse, from one plane
# 2: inverse, from multiple planes
# 3: forward, from robot
list_3 = ValueList({"0 forward, from angles": 0, "1 inverse, from one plane": 1, "2 inverse, from multiple planes": 2, "3 forward, from robot": 3}, selected="0 forward, from angles")
planes_wcs = Plane(py)
robot_3 = Data(robot_2)

# ---- group: Calculate joint positions for path
# Add init joint states
joint_states = Data([-0.1728179112, -1.415058186, 1.813991282, -1.971940356, -1.571654205, -3.308720436])
init_configuration = Slider(0, range=0..7)
py_3 = PythonScript(robot=robot_3, planes_WCS=planes_wcs, configuration_idx=init_configuration, init_configuration=joint_states)  # -> configurations, configurations_list; inputs planes_WCS: list, configuration_idx: Int32, init_configuration: list
# ---------- py_3: Python ----------
import Rhino.Geometry as rg
from compas_fab.fab.geometry import Frame, Transformation
from compas_fab.fab.grasshopper import xdraw_frame
from compas_fab.fab.robots.ur.kinematics import calculate_configurations_for_path, format_joint_positions
from compas_fab.fab.robots import BaseConfiguration


# TODO this must be optimized! matrix multiplication!
frames_tool0_RCS = []
for plane_WCS in planes_WCS:
    tcp_WCS = Frame(plane_WCS.Origin, plane_WCS.XAxis, plane_WCS.YAxis)
    tcp_RCS = robot.get_frame_in_RCS(tcp_WCS)
    frames_tool0_RCS.append(robot.get_tool0_frame_from_tcp_frame(tcp_RCS))
    

configurations = calculate_configurations_for_path(frames_tool0_RCS, robot, BaseConfiguration.from_joints(init_configuration))

configurations = configurations[min([configuration_idx, len(configurations) - 1])]

print len(configurations)


configurations_list = [c.joint_values for c in configurations]
# ---------- end py_3 ----------
start = Button()
stop = Button()
step = Button()
counter = CountThroughList(L=py_3.configurations, start=start, stop=stop, step=step, interval=100)  # -> item; inputs L: list, start: Boolean, stop: Boolean
# ---------- counter: Python ----------
from scriptcontext import sticky as st
from compas_fab.fab.grasshopper import update_component


# store data in component
guid = str(ghenv.Component.InstanceGuid)
counter_key = "counter_" + guid
running_key = "running_" + guid

if counter_key not in st or st[counter_key] > len(L):
    st[counter_key] = 0

if running_key not in st:
    st[running_key] = False

if start:
    st[running_key] = True

if stop:
    st[running_key] = False

if step:
    if st[counter_key] < len(L) - 1:
        st[counter_key] += 1
        print st[counter_key]
    
if len(L):
    item = L[st[counter_key]]


if st[running_key]:
    if st[counter_key] < len(L) - 1:
        st[counter_key] += 1
        update_component(ghenv, interval)
    else:
        st[counter_key] = 0
        st[running_key] = False
# ---------- end counter ----------

# ---- group: Define plane in WCS, calculate joint positions
pt = Point(Point(-360.5993803, 127.1359598, 433.9356602))
select_configuration = Slider(5, range=0..7)
xy = XYPlane(Origin=pt)
plane_wcs = Plane(xy)
inverse = PythonScript(robot=robot_3, plane_WCS=plane_wcs, idx=select_configuration)  # -> configuration; inputs plane_WCS: Plane, idx: Int32
# ---------- inverse: Python ----------
import Rhino.Geometry as rg
from compas_fab.fab.geometry import Frame, Transformation
from compas_fab.fab.grasshopper import xdraw_frame

tcp_WCS = Frame(plane_WCS.Origin, plane_WCS.XAxis, plane_WCS.YAxis)

# transform frame to robot coordinate system
tcp_RCS = robot.get_frame_in_RCS(tcp_WCS)

# get the frame of tool0
tool0_RCS = robot.get_tool0_frame_from_tcp_frame(tcp_RCS)

# calculate solutions to frame
solutions = robot.inverse_kinematics(tool0_RCS)

if not len(solutions):
    q = [0,0,0,0,0,0]
else:
    idx = min(len(solutions) - 1, idx)
    q = solutions[idx]
    
print q

configuration = q
# ---------- end inverse ----------

# ---- group: Calculate joint positions for path / Shows joint positions along path
flip = BooleanToggle(True)
l2t = PythonScript(L=py_3.configurations_list, flip=flip)  # -> T; inputs L: list, flip: Boolean
# ---------- l2t: Python ----------
from compas_fab.fab.grasshopper import list_to_tree

if flip:
    L = list(zip(*L))
T = list_to_tree(L)
# ---------- end l2t ----------
graph = QuickGraph(l2t)

# ---- group: Define joint positions
base_2 = Slider(-19.362, range=-360..360)
elbow = Slider(-97.714, range=-360..360)
wrist2 = Slider(-275.027, range=-360..360)
wrist3 = Slider(-138.857, range=-360..360)
shoulder = Slider(-69.12, range=-360..360)
wrist1 = Slider(-97.714, range=-360..360)
ur1_q1_q6 = Data([base_2, shoulder, elbow, wrist1, wrist2, wrist3])
rad = Radians(Degrees=ur1_q1_q6)

# ----
py_4 = PythonScript(q=rad)  # -> configuration; inputs q: list
# ---------- py_4: Python ----------
from compas_fab.fab.robots import BaseConfiguration

configuration = BaseConfiguration.from_joints(q)
# ---------- end py_4 ----------

# ---- group: Visualise
filter_2 = StreamFilter(Gate=list_3, Stream0=py_4, Stream1=inverse, Stream2=counter)
show_brep = BooleanToggle(False)
draw = PythonScript(robot=robot_3, configuration=filter_2, show_brep=show_brep)  # -> meshes, tool0_plane, tcp_plane, breps
# ---------- draw: Python ----------
from compas_fab.fab.grasshopper import xdraw_frame
from compas_fab.fab.grasshopper import xtransform
from compas_fab.fab.geometry import Frame, Transformation
import Rhino.Geometry as rg

q = configuration

print q

transformations = robot.get_forward_transformations(q)
T0, T1, T2, T3, T4, T5 = transformations
#meshes = robot.get_transformed_model(transformations, xtransform)
#meshes += robot.get_transformed_tool_model(T5, xtransform)

meshes = robot.xdraw(configuration, xtransform)

tool0_frame, tcp_frame = robot.get_transformed_tool_frames(T5)
tool0_plane = xdraw_frame(tool0_frame)
tcp_plane = xdraw_frame(tcp_frame)

breps = []

if show_brep:
    if len(robot.breps):
        for i, b in enumerate(robot.breps):
            T = transformations[i]
            breps.append(xtransform(b, T, copy=True))
        if len(robot.tool.breps):
            Tt = robot.get_tool0_transformation(T5)
            for i, b in enumerate(robot.tool.breps):
                breps.append(xtransform(b, Tt, copy=True))
# ---------- end draw ----------
tool0_plane = Plane(draw.tool0_plane)
robot_brep = Brep(draw.breps)
tcp_plane = Plane(draw.tcp_plane)
draw_2 = RepresentPlaneAsLines(plane=tcp_plane, size=100)  # -> G, C
# ---------- draw_2: Python ----------
import Rhino.Geometry as rg
from System.Drawing import Color

if plane:

    G = []
    G.append(rg.Line(plane.Origin, size * plane.XAxis))
    G.append(rg.Line(plane.Origin, size * plane.YAxis))
    G.append(rg.Line(plane.Origin, size * plane.ZAxis))
    
    C = []
    C.append(Color.FromArgb(255, 0, 0))
    C.append(Color.FromArgb(0, 255, 0))
    C.append(Color.FromArgb(0, 0, 255))
# ---------- end draw_2 ----------
preview_2 = CustomPreview(Geometry=draw.meshes, Shader=ColourSwatch(SwatchColor=RGBA(99, 94, 94, 96)))
preview_3 = CustomPreview(Geometry=draw_2.G, Shader=draw_2.C)

# ---- group: breps
base_shoulder = Brep(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)
upperarm = Brep(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)
forearm = Brep(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)
wrist3_2 = Brep(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)
wrist1_2 = Brep(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)
wrist2_2 = Brep(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)

base_shoulder_2 = Brep(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)
upperarm_2 = Brep(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)
forearm_2 = Brep(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)
wrist1_3 = Brep(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)
wrist2_3 = Brep(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)
wrist3_3 = Brep(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)

# ----
ur10_geo = Brep([base_shoulder_2, wrist2_3, upperarm_2, wrist1_3, forearm_2, wrist3_3])
# inclination_length for 2, 4, 10, 15
# inclination_length for 30
# Calculate edge curves
ur5_brep_2 = Brep([base_shoulder, upperarm, forearm, wrist1_2, wrist2_2, wrist3_2])

# ==== cluster Tools
tool_id = ClusterInput()

test_geometry = Geometry([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])
yaxis_line = Curve(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)
xaxis_line = Curve(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)
mesh = Mesh(test_geometry)
brep = Brep(test_geometry)
tool = Tool(meshes=mesh, breps=brep, xline=xaxis_line, yline=yaxis_line)

# ---- group: measurement tool
measurement_tool_geo = Geometry([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])
tool_2 = PythonScript(breps=measurement_tool_geo)  # -> tool; inputs breps: list
# ---------- tool_2: Python ----------
from compas_fab.fab.robots.ur.tools import MeasurementTool
from compas_fab.fab.grasshopper.helpers import draw_mesh

tool = MeasurementTool()
tool.load_model(xdraw_function=draw_mesh)
tool.breps = breps
# ---------- end tool_2 ----------

# ----
tool_id_2 = Integer(tool_id)
tool_3 = PythonScript()  # -> tool
# ---------- tool_3: Python ----------
from compas_fab.fab.geometry import Frame
from compas_fab.fab.robots import Tool

tcp_frame = Frame.worldXY()

tool = Tool(tcp_frame)
tool.model = []
tool.breps = []
# ---------- end tool_3 ----------
filter = StreamFilter(Gate=tool_id_2, Stream0=tool_3, Stream1=tool_2, Stream2=tool)
py = PythonScript(tool=filter)  # -> tcp_frame, model
# ---------- py: Python ----------
tcp_frame = tool.tcp_frame
model = tool.model
# ---------- end py ----------
tool_4 = Data(filter)
draw = PythonScript(frame=py.tcp_frame)  # -> G, C
# ---------- draw: Python ----------
import Rhino.Geometry as rg
from System.Drawing import Color

if not size:
    size = 100

if frame:
    
    plane = rg.Plane(rg.Point3d(*frame.point), rg.Vector3d(*frame.xaxis), rg.Vector3d(*frame.yaxis))

    G = []
    G.append(rg.Line(plane.Origin, size * plane.XAxis))
    G.append(rg.Line(plane.Origin, size * plane.YAxis))
    G.append(rg.Line(plane.Origin, size * plane.ZAxis))
    
    C = []
    C.append(Color.FromArgb(255, 0, 0))
    C.append(Color.FromArgb(0, 255, 0))
    C.append(Color.FromArgb(0, 0, 255))
# ---------- end draw ----------
tool_5 = ClusterOutput(tool_4)
preview = CustomPreview(Geometry=draw.G, Shader=draw.C)
preview_2 = CustomPreview(Geometry=py.model, Shader=ColourSwatch(SwatchColor=RGB(141, 170, 178)))

# ==== cluster Tool
breps = ClusterInput()
meshes = ClusterInput()
meshes_2 = Mesh(meshes)
mjoin = MeshJoin(Meshes=meshes_2)
xline = ClusterInput()
yline = ClusterInput()
tool = PythonScript(meshes=mjoin, breps=breps, xline=xline, yline=yline)  # -> tool; inputs meshes: list of Mesh, breps: list of Brep
# ---------- tool: Python ----------
import Rhino.Geometry as rg
from compas_fab.fab.geometry import Frame
from compas_fab.fab.robots import Tool
from compas.datastructures.mesh import Mesh

xaxis = rg.Line(xline.PointAtStart, xline.PointAtEnd)
yaxis = rg.Line(yline.PointAtStart, yline.PointAtEnd)

if xaxis.From.DistanceTo(yaxis.From) < 0.01:
    origin = xaxis.From
    xaxis = xaxis.Direction
    yaxis = yaxis.Direction
elif xaxis.To.DistanceTo(yaxis.To) < 0.01:
    origin = xaxis.To
    xaxis = -xaxis.Direction
    yaxis = -yaxis.Direction
elif xaxis.From.DistanceTo(yaxis.To) < 0.01:
    origin = xaxis.From
    xaxis = xaxis.Direction
    yaxis = -yaxis.Direction
elif xaxis.To.DistanceTo(yaxis.From) < 0.01:
    origin = xaxis.To
    xaxis = -xaxis.Direction
    yaxis = yaxis.Direction

xaxis.Unitize()
yaxis.Unitize()

print origin
print xaxis
print yaxis

tcp_frame = Frame(origin, xaxis, yaxis)

tool = Tool(tcp_frame)
tool.model = meshes
tool.breps = breps
# ---------- end tool ----------
tool_2 = ClusterOutput(tool)
